# Dynamo graph Change_Fonts__V2.dyn "Change_Fonts" (Dynamo 2.6.1.8786)

# group: Text & Labels
element_types = ElementTypes("TextElementType")
all_elements_of_type = ElementsOfType(element_type=element_types)
parameters = Element.Parameters(element=all_elements_of_type)
code_block = CodeBlock { "Family Name"; }
parameterByName = Parameter.ParameterByName(element=all_elements_of_type, name=code_block)

search_for = StringInput("Arial")  # graph input
replace_with = StringInput("SACS FONT")  # graph input

# group: Text
text = BoolSelector(true)  # graph input
code_block_2 = CodeBlock(v=parameterByName, c=text) { v.Value=="Text" && c==true; }
boolean = BoolSelector(true)
allIndicesOf = List.AllIndicesOf(list=code_block_2, item=boolean)
getItemAtIndex = List.GetItemAtIndex(list=all_elements_of_type, index=allIndicesOf)
code_block_3 = CodeBlock { "Text Font"; }
parameterByName_2 = Parameter.ParameterByName(element=getItemAtIndex, name=code_block_3)  # graph output
code_block_4 = CodeBlock(p=parameterByName_2, userInput=search_for) { p.Value== userInput; }
boolean_2 = BoolSelector(true)
allIndicesOf_2 = List.AllIndicesOf(list=code_block_4, item=boolean_2)
getItemAtIndex_2 = List.GetItemAtIndex(list=getItemAtIndex, index=allIndicesOf_2)
setParameterByName = Element.SetParameterByName(element=getItemAtIndex_2, parameterName=code_block_3, value=replace_with)

# group: Label
label = BoolSelector(true)  # graph input
code_block_5 = CodeBlock(v=parameterByName, c=label) { v.Value=="Label"&& c==true; }
boolean_3 = BoolSelector(true)
allIndicesOf_3 = List.AllIndicesOf(list=code_block_5, item=boolean_3)
getItemAtIndex_3 = List.GetItemAtIndex(list=all_elements_of_type, index=allIndicesOf_3)
code_block_6 = CodeBlock { "Text Font"; }
parameterByName_3 = Parameter.ParameterByName(element=getItemAtIndex_3, name=code_block_6)  # graph output
code_block_7 = CodeBlock(p=parameterByName_3, userInput=search_for) { p.Value== userInput; }
boolean_4 = BoolSelector(true)
allIndicesOf_4 = List.AllIndicesOf(list=code_block_7, item=boolean_4)
getItemAtIndex_4 = List.GetItemAtIndex(list=getItemAtIndex_3, index=allIndicesOf_4)
setParameterByName_2 = Element.SetParameterByName(element=getItemAtIndex_4, parameterName=code_block_6, value=replace_with)

# group: System Families
categories = Categories("OST_RoomTags")
all_elements_of_category = ElementsOfCategory(Category=categories)
categories_2 = Categories("OST_WallTags")
all_elements_of_category_2 = ElementsOfCategory(Category=categories_2)
categories_3 = Categories("OST_WindowTags")
all_elements_of_category_3 = ElementsOfCategory(Category=categories_3)
categories_4 = Categories("OST_DoorTags")
all_elements_of_category_4 = ElementsOfCategory(Category=categories_4)
categories_5 = Categories("OST_GenericAnnotation")
all_elements_of_category_5 = ElementsOfCategory(Category=categories_5)
list_create = List.Create(item0=all_elements_of_category, item1=all_elements_of_category_2, item2=all_elements_of_category_3, item3=all_elements_of_category_4, item4=all_elements_of_category_5)
flatten = List.Flatten(list=list_create)
elementType = Element.ElementType(element=flatten)
getParameterValueByName = Element.GetParameterValueByName(element=elementType)  # unwired: parameterName
system_families = BoolSelector(false)  # graph input
uniqueItems = List.UniqueItems(list=elementType)
family = FamilyType.Family(familyType=uniqueItems)
python_script = Python(IN[0]=system_families, IN[1]=family, IN[2]=replace_with, IN[3]=search_for)
# ---------- python_script.python (102 lines) ----------
import clr
 
# Import DocumentManager and TransactionManager...
clr.AddReference("RevitServices")
import RevitServices
from RevitServices.Persistence import DocumentManager
from RevitServices.Transactions import TransactionManager
doc = DocumentManager.Instance.CurrentDBDocument
uidoc = DocumentManager.Instance.CurrentUIDocument
 
# Import RevitAPI...
clr.AddReference("RevitAPI")
from Autodesk.Revit.DB import *
 
 
############## Classes ###############
 
# Define FamilyLoadOptions...
class FamilyOption(IFamilyLoadOptions):
    def OnFamilyFound(self,familyInUse,overwriteParameterValues):
        overwriteParameterValues = True
        return True
 
    def OnSharedFamilyFound(self, sharedFamily, familyInUse, familySrc, overwriteParameterValues):
        familySrc = FamilySource.Family
        overwriteParameterValues = True
        return True
 
############# Definitions ##############
 
# Open and search family doc for suitable Element Types to set font...
def UpdateTextFontInFamily(doc, f):
    # Must force close all open transactions to open family...
    TransactionManager.Instance.ForceCloseTransaction()
    try:
        arr = []
        outList.append(f.Name)
        # The Parameter we are looking for...
        bip = BuiltInParameter.TEXT_FONT
          
        # Open Family Document...
        fDoc = doc.EditFamily(f)
        ElementTypes = FilteredElementCollector(fDoc).OfClass(ElementType).ToElements()
 
        # Wrap in a Transaction...
        TransactionManager.Instance.EnsureInTransaction(fDoc)
        # Search all ElementTypes for Parameter and set Text Font if found...
        for i in ElementTypes:
            tArr = []
            try:
                p = i.get_Parameter(bip)
                v = p.AsString()
                if v == Current:
                	p.Set(font)
                	tArr.append(i.FamilyName)
                	tArr.append(i.get_Parameter(bip).AsString())
                	arr.append(tArr)
    			
               
            # If parameter was not found in this ElementType then move on to next ElementType...
            except:
                continue
 
        outList.append(arr)        
        # Must Force Close Transaction to close FamilyDoc...
        TransactionManager.Instance.ForceCloseTransaction()
        # Load Family back into project and Close Family Document...
        fDoc.LoadFamily(doc, FamilyOption())
        fDoc.Close(False)
    except Exception,e:
        outList.append(f.Name + " Failed:-\n" + e.message)
 
# Convert single object to list if not list already
def tolist(obj1):
    if hasattr(obj1,"__iter__"): return obj1
    else: return [obj1]
 
############## Inputs ###############
 
run = tolist(IN[0])[0]
fams = tolist(UnwrapElement(IN[1]))
font = tolist(IN[2])[0]
Current = tolist(IN[3])[0]
 
############## Outputs ###############
 
outList = []
 
############## Main ###############
if run:
    for f in fams:
        try:
            # Skip InPlace Families...
            if f.IsInPlace:
                UpdateTextFontInFamily(doc,f)
        except Exception,e:
            outList.append("Failed:-\n" + e.message)
    # Refresh the Active View to see changes immediately...
    uidoc.RefreshActiveView()
    OUT = outList
else:
    OUT = "Please set Run to True"
# ----------------------------------------

# group: Dimension
element_types_2 = ElementTypes("DimensionType")
all_elements_of_type_2 = ElementsOfType(element_type=element_types_2)
parameters_2 = Element.Parameters(element=all_elements_of_type_2)
code_block_8 = CodeBlock(p=parameters_2) { p.Name =="Text Font"; }
boolean_5 = BoolSelector(true)
allIndicesOf_5 = List.AllIndicesOf(list=code_block_8@L2, item=boolean_5)
isEmpty = List.IsEmpty(list=allIndicesOf_5@L2)
boolean_6 = BoolSelector(false)
allIndicesOf_6 = List.AllIndicesOf(list=isEmpty, item=boolean_6)
getItemAtIndex_5 = List.GetItemAtIndex(list=all_elements_of_type_2, index=allIndicesOf_6)
code_block_9 = CodeBlock { "Text Font"; }
parameterByName_4 = Parameter.ParameterByName(element=getItemAtIndex_5, name=code_block_9)
dimension = BoolSelector(false)  # graph input
code_block_10 = CodeBlock(p=parameterByName_4, userInput=search_for, d=dimension) { p.Value == userInput && d==true; }
boolean_7 = BoolSelector(true)
allIndicesOf_7 = List.AllIndicesOf(list=code_block_10, item=boolean_7)
getItemAtIndex_6 = List.GetItemAtIndex(list=getItemAtIndex_5@L2, index=allIndicesOf_7, lacing=Shortest)
code_block_11 = CodeBlock { "Text Font"; }
setParameterByName_3 = Element.SetParameterByName(element=getItemAtIndex_6, parameterName=code_block_11, value=replace_with)
code_block_12 = CodeBlock(v=parameterByName_4) { v.Value; }

code_block_13 = CodeBlock(p=python_script) { p.Value; }
code_block_14 = CodeBlock(p=parameterByName_3) { p.Value; }
code_block_15 = CodeBlock(p=parameterByName_2) { p.Value; }
list_create_2 = List.Create(item0=code_block_12, item1=code_block_13, item3=code_block_14, item4=code_block_15)  # unwired: item2
used_fonts = List.UniqueItems(list=list_create_2)

# group: Loaded Families
categories_6 = Categories("OST_RoomTags")
all_elements_of_category_6 = ElementsOfCategory(Category=categories_6)
categories_7 = Categories("OST_WallTags")
all_elements_of_category_7 = ElementsOfCategory(Category=categories_7)
categories_8 = Categories("OST_WindowTags")
all_elements_of_category_8 = ElementsOfCategory(Category=categories_8)
categories_9 = Categories("OST_DoorTags")
all_elements_of_category_9 = ElementsOfCategory(Category=categories_9)
categories_10 = Categories("OST_GenericAnnotation")
all_elements_of_category_10 = ElementsOfCategory(Category=categories_10)
list_create_3 = List.Create(item0=all_elements_of_category_6, item1=all_elements_of_category_7, item2=all_elements_of_category_8, item3=all_elements_of_category_9, item4=all_elements_of_category_10)
flatten_2 = List.Flatten(list=list_create_3)
elementType_2 = Element.ElementType(element=flatten_2)
getParameterValueByName_2 = Element.GetParameterValueByName(element=elementType_2)  # unwired: parameterName
loaded_families = BoolSelector(false)  # graph input
uniqueItems_2 = List.UniqueItems(list=elementType_2)
family_2 = FamilyType.Family(familyType=uniqueItems_2)
python_script_2 = Python(IN[0]=loaded_families, IN[1]=family_2, IN[2]=replace_with, IN[3]=search_for)
# ---------- python_script_2.python (102 lines) ----------
import clr
 
# Import DocumentManager and TransactionManager...
clr.AddReference("RevitServices")
import RevitServices
from RevitServices.Persistence import DocumentManager
from RevitServices.Transactions import TransactionManager
doc = DocumentManager.Instance.CurrentDBDocument
uidoc = DocumentManager.Instance.CurrentUIDocument
 
# Import RevitAPI...
clr.AddReference("RevitAPI")
from Autodesk.Revit.DB import *
 
 
############## Classes ###############
 
# Define FamilyLoadOptions...
class FamilyOption(IFamilyLoadOptions):
    def OnFamilyFound(self,familyInUse,overwriteParameterValues):
        overwriteParameterValues = True
        return True
 
    def OnSharedFamilyFound(self, sharedFamily, familyInUse, familySrc, overwriteParameterValues):
        familySrc = FamilySource.Family
        overwriteParameterValues = True
        return True
 
############# Definitions ##############
 
# Open and search family doc for suitable Element Types to set font...
def UpdateTextFontInFamily(doc, f):
    # Must force close all open transactions to open family...
    TransactionManager.Instance.ForceCloseTransaction()
    try:
        arr = []
        outList.append(f.Name)
        # The Parameter we are looking for...
        bip = BuiltInParameter.TEXT_FONT
          
        # Open Family Document...
        fDoc = doc.EditFamily(f)
        ElementTypes = FilteredElementCollector(fDoc).OfClass(ElementType).ToElements()
 
        # Wrap in a Transaction...
        TransactionManager.Instance.EnsureInTransaction(fDoc)
        # Search all ElementTypes for Parameter and set Text Font if found...
        for i in ElementTypes:
            tArr = []
            try:
                p = i.get_Parameter(bip)
                v = p.AsString()
                if v == Current:
                	p.Set(font)
                	tArr.append(i.FamilyName)
                	tArr.append(i.get_Parameter(bip).AsString())
                	arr.append(tArr)
    			
               
            # If parameter was not found in this ElementType then move on to next ElementType...
            except:
                continue
 
        outList.append(arr)        
        # Must Force Close Transaction to close FamilyDoc...
        TransactionManager.Instance.ForceCloseTransaction()
        # Load Family back into project and Close Family Document...
        fDoc.LoadFamily(doc, FamilyOption())
        fDoc.Close(False)
    except Exception,e:
        outList.append(f.Name + " Failed:-\n" + e.message)
 
# Convert single object to list if not list already
def tolist(obj1):
    if hasattr(obj1,"__iter__"): return obj1
    else: return [obj1]
 
############## Inputs ###############
 
run = tolist(IN[0])[0]
fams = tolist(UnwrapElement(IN[1]))
font = tolist(IN[2])[0]
Current = tolist(IN[3])[0]
 
############## Outputs ###############
 
outList = []
 
############## Main ###############
if run:
    for f in fams:
        try:
            # Skip InPlace Families...
            if not f.IsInPlace:
                UpdateTextFontInFamily(doc,f)
        except Exception,e:
            outList.append("Failed:-\n" + e.message)
    # Refresh the Active View to see changes immediately...
    uidoc.RefreshActiveView()
    OUT = outList
else:
    OUT = "Please set Run to True"
# ----------------------------------------

code_block_16 = CodeBlock {  }
